% Simulink data dictionary HevIps.sldd
% references VehCong.sldd

RBEMS = Simulink.VariantExpression(Condition="VCU_Mode == 1")
RBEMSDG = Simulink.VariantExpression(Condition="VCU_Mode == 2")
DRLEMS = Simulink.VariantExpression(Condition="VCU_Mode == 3")
VCU_Mode = Simulink.Parameter(2)